# Grasshopper definition 220212_changeLayerVisibility_gh_cSharp.gh (Grasshopper 1.0.7)

# https://github.com/alitehami/RandomPrototypes
number_slider = Slider(5, range=0..5)

# ---- group: Layers
c_script = CSharpScript()  # -> A
# ---------- c_script: C# ----------
   //ali.tehami@yahoo.com 12/02/2022
    A = RhinoDoc.ActiveDoc.Layers;
# ---------- end c_script ----------

# ----
layers = Panel(c_script)

# ---- group: Selected Layer Visibility
c_script_2 = CSharpScript(x=c_script, i=number_slider, y=Toggle(True))  # -> out; inputs x: list, i: Int32, y: Boolean
# ---------- c_script_2: C# ----------
   //ali.tehami@yahoo.com 12/02/2022
    (x[i] as Rhino.DocObjects.Layer).IsVisible = y;
# ---------- end c_script_2 ----------
